# Grasshopper definition SurfacePatternTool.gh (Grasshopper 1.0.8)

solidin = Brep(<brep referenced from the Rhino model>)
frontface = Slider(22, range=0..46)
u_count = Slider(12, range=1..40)
v_count = Slider(8, range=1..40)
radius = Slider(2, range=0.1..6)
cutdepth = Slider(1.5, range=0.1..10)
debrep = DeconstructBrep(Brep=solidin)  # -> Faces, Edges, Vertices
item = ListItem(List=debrep.Faces, Index=frontface, Wrap=True)
subtraction = Subtraction(A=radius, B=cutdepth)
sdivide = DivideSurface(Surface=item, UCount=u_count, VCount=v_count)  # -> Points, Normals, Parameters
amp = Amplitude(Vector=sdivide.Normals, Amplitude=subtraction)
move = Move(Geometry=sdivide.Points, Motion=amp)  # -> Geometry, Transform
sph = Sphere(Base=move.Geometry, Radius=radius)
sdiff = SolidDifference(BrepsA=solidin, BrepsB=sph)
